# Grasshopper definition zuricharea.gh (Grasshopper 1.0.7)

crv = Curve([<curve referenced from the Rhino model> x242])
cls = Closed(Curve=crv)  # -> Closed, Periodic
dispatch = Dispatch(List=crv, DispatchPattern=cls.Closed)  # -> ListA, ListB
crv_2 = Curve(dispatch.ListA)
area = Area(Geometry=crv_2)  # -> Area, Centroid
sort = SortList(Keys=area.Area, ValuesA=crv_2)  # -> Keys, ValuesA, ValuesB
lng = ListLength(List=sort.ValuesA)
division = Division(A=lng, B=Slider(1, range=0..10))
split = SplitList(List=sort.Keys, Index=division)  # -> ListA, ListB
split_2 = SplitList(List=sort.ValuesA, Index=division)  # -> ListA, ListB
boundary = BoundarySurfaces(Edges=split_2.ListA)
shift = ShiftList(List=split.ListA, Shift=-1, Wrap=True)
ma = MassAddition(Input=area.Area)  # -> Result, PartialResults
item = ListItem(List=shift, Index=0, Wrap=True)  # -> Item, Item1
multiplication = Multiplication(A=ma.Result, B=Slider(50000, range=0..100000))
gradient = Gradient(
    LowerLimit=item.Item1,
    UpperLimit=item.Item,
    Parameter=split.ListA,
    stops=[0: RGB(234, 38, 0), 0.0536: RGB(234, 126, 0), 0.5: RGB(254, 244, 84), 0.92: RGB(173, 203, 249), 1: RGB(75, 107, 169)])
preview = CustomPreview(Geometry=boundary, Material=gradient)
panel = Panel([item.Item, item.Item1])
panel_2 = Panel(multiplication)
