# Grasshopper definition testHelloWorld.gh (Grasshopper 1.0.7)

string = GetString("World", AtLeast=1, AtMost=1, TreeAccess=False)
concat = Concatenate(FragmentA="Hello ", FragmentB=string)
panel = Panel(concat)
context_print = ContextPrint(Text=concat)
